# Dynamo graph GUID's Shared Parameters DELETE.dyn (Dynamo 2.19.3.6394)
# packages: archi-lab.net 2024.217.1024

element_types = ElementTypes("SharedParameterElement")
all_elements_of_type = ElementsOfType(element_type=element_types)
name = Element.Name(element=all_elements_of_type)
code_block = CodeBlock { "AcousticRating"; "4acc7e06-88f4-5097-ac52-bcc48f7777fc"; }
contains = String.Contains(string=name@L2, searchFor=code_block.out0, lacing=Longest)
filterByBoolMask = List.FilterByBoolMask(list=all_elements_of_type@L2, mask=contains, lacing=Longest)
flatten = List.Flatten(list=filterByBoolMask.in)
name_2 = Element.Name(element=flatten)
python_script = Python(IN[0]=flatten)  # IronPython2
# ---------- python_script.python (1 lines) ----------
OUT = [UnwrapElement(x).GuidValue for x in IN[0]]
# ----------------------------------------
string_from_object = FromObject(obj=python_script)
indexOf = List.IndexOf(list=string_from_object, element=code_block.out1)
removeItemAtIndex = List.RemoveItemAtIndex(list=flatten, indices=indexOf)
code_block_2 = CodeBlock { "IfcObjectType"; "e5cb0549-f76a-5a30-a2ab-066d82c11667"; }
code_block_3 = CodeBlock { "FireRating"; "48437df2-c39c-5c53-86ad-a05da162c2b8"; }
code_block_4 = CodeBlock { "IsExternal"; "be41acae-c1c2-5b41-8e69-313dcfb70e31"; }
code_block_5 = CodeBlock { "LoadBearing"; "a19465ba-9891-5f1c-a592-e712e17e3e51"; }
code_block_6 = CodeBlock { "Combustible"; "f094ee12-a7d3-5241-8e46-a01ff4f16c57"; }
code_block_7 = CodeBlock { "FireExit"; "4db5afc9-9bf7-53c0-a73c-cda18d227afc"; }
list_create = List.Create(item0=code_block_2.out0, item1=code_block_3.out0, item2=code_block.out0, item3=code_block_4.out0, item4=code_block_5.out0, item5=code_block_6.out0, item6=code_block_7.out0)
list_create_2 = List.Create(item0=code_block_2.out1, item1=code_block_3.out1, item2=code_block.out1, item3=code_block_4.out1, item4=code_block_5.out1, item5=code_block_6.out1, item6=code_block_7.out1)
string = StringInput("""metselwerk_verband
metselwerk_voegtype""")
string_2 = StringInput("\n")
split = String.Split(string=string, separator0=string_2)
delete = archilab.Revit.Elements.Elements.Delete()  # unwired: element
code_block_8 = CodeBlock { 0..2; }
getItemAtIndex = List.GetItemAtIndex(list=flatten, index=code_block_8)
list_create_3 = List.Create()  # unwired: item0, item1
flatten_2 = List.Flatten(list=list_create_3)
